# Grasshopper definition test_main_2.gh (Grasshopper 1.0.8)

panel = Panel("0.000,0.000,0.000;-60.839,116.315,0.000;66.210,46.113,0.000;25.117,-13.149,0.000;0.000,0.000,0.000")
no_of_floors = GetNumber(Slider(3, range=0..10), AtLeast=1, AtMost=1, Maximum=1.797693135e+308, Minimum=-1.797693135e+308, TreeAccess=False)
floor_height = GetNumber(Slider(3, range=0..10), AtLeast=1, AtMost=1, Maximum=1.797693135e+308, Minimum=-1.797693135e+308, TreeAccess=False)
building_vertices = GetString(panel, AtLeast=1, AtMost=1, TreeAccess=False)
split = TextSplit(Text=building_vertices, Separators=";")
series = Series(Start=floor_height, Step=floor_height, Count=no_of_floors)
Z = UnitZ(Factor=series)
pline = PolyLine(Vertices=split, Closed=True)
move = Move(Geometry=pline, Motion=Z)  # -> Geometry, Transform
mjoin = MeshJoin(Meshes=move.Geometry)
Z_2 = UnitZ(Factor=Slider(0.15, range=0..1))
extr = Extrude(Base=move.Geometry, Direction=Z_2)
mcol = MeshColours(Mesh=mjoin, Colours=ColourSwatch(SwatchColor=RGBA(217, 168, 72, 169)))
cap = CapHoles(Brep=extr)

# ---- group: RH_OUT:meshout
mesh = Mesh(mcol)
